# Grasshopper definition test.gh (Grasshopper 1.0.8)
# plug-ins: Ironbug.Grasshopper, Ironbug.Viewer.GH

brep = Brep([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])
dup = DuplicateData(Data=brep, Number=Slider(200, range=0..1000), Order=True)
roomsolid = HBRoomFromSolid(geo=flatten(brep), conditioned=True)  # -> report, rooms; plug-in component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

# ----
# Hot water loop
pumpvariable = Ironbug_PumpVariableSpeed(dupNum=False)

objparams = IB_ObjParams(
    BoilerFlowMode="LeavingSetpointModulated",
    MaximumPartLoadRatio="1.5",
    NominalThermalEfficiency="0.78",
    DataFieldSetType="Ironbug.HVAC.IB_BoilerHotWater_FieldSet")
boiler = Ironbug_BoilerHotWater(Parameters_=objparams, dupNum=False)
objparams_2 = IB_ObjParams(DesignLoopExitTemperature="82.2", DataFieldSetType="Ironbug.HVAC.IB_SizingPlant_FieldSet")
plantbranches = PlantBranches(Branch1=boiler, mapBranchToLoop=False)
plantbranches_2 = PlantBranches(mapBranchToLoop=False)
spm_scheduled = Ironbug_SetpointManagerScheduled(Temperature="82.2", dupNum=False)
sizingplant = IB_SizingPlant(Parameters_=objparams_2, dupNum=False)
hotwaterloop = Ironbug_HotWaterPlantLoop(Supply=[pumpvariable, plantbranches, spm_scheduled], Demand=plantbranches_2, SizingLoop=sizingplant, dupNum=False)

# ---- group: Sys06_PackagedVAV_PFP Reheat
# Double click the component for more details
sys06 = Sys06(hbrooms=flatten(roomsolid.rooms))

# ---- group: Sys07_VAV Reheat
# Double click the component for more details
sys07 = Sys07(hbrooms=flatten(roomsolid.rooms))

# ----
hvacsystem = IB_HVACSystem(PlantLoops=flatten(hotwaterloop))
viewer_wip = IB_ViewerWIP()

# ==== cluster Sys06
hbrooms = ClusterInput()  # Honeybee Rooms to which the HVAC system should be assigned.
objparams = IB_ObjParams(PressureRise="300", DataFieldSetType="Ironbug.HVAC.IB_FanConstantVolume_FieldSet")

# ----
# Sys06_PackagedVAV_PFP Reheat
# Airloop
# HBZones
rooms = Data(flatten(hbrooms))
objparams_2 = IB_ObjParams(
    AllOutdoorAirinCooling=Toggle(False),
    AllOutdoorAirinHeating=Toggle(False),
    CentralHeatingDesignSupplyAirTemperature="12.8",
    DataFieldSetType="Ironbug.HVAC.IB_SizingSystem_FieldSet")
oasystem = Ironbug_OutdoorAirSystem()
coilclndx2 = Ironbug_CoilCoolingDXTwoSpeed(dupNum=False)
spm_scheduled = Ironbug_SetpointManagerScheduled(Temperature="12.8", dupNum=False)
sizingsystem = Ironbug_SizingSystem(Parameters_=objparams_2, dupNum=False)

roomsbyattr = HBRoomsByAttribute(rooms=flatten(rooms), attribute="zone")  # -> values, rooms; plug-in component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
objparams_3 = IB_ObjParams(
    EndUseSubcategory="VAV System Fans",
    FanEfficiency="0.616",
    FanPowerMinimumFlowFraction="0.25",
    FanPowerMinimumFlowRateInputMethod="Fraction",
    MotorEfficiency="0.895",
    PressureRise="996",
    DataFieldSetType="Ironbug.HVAC.IB_FanVariableVolume_FieldSet")
objparams_4 = IB_ObjParams(
    ZoneCoolingDesignSupplyAirTemperature="12.8",
    ZoneHeatingDesignSupplyAirTemperature="50",
    DataFieldSetType="Ironbug.HVAC.IB_SizingZone_FieldSet")
sizingzone = IB_SizingZone(Parameters_=objparams_4, dupNum=False)
coilhtnelec = IB_CoilHeatingElectric(dupNum=False)
objparams_5 = IB_ObjParams(NightCycleControlType="CycleOnAny", DataFieldSetType="Ironbug.HVAC.IB_AirLoopHVAC_FieldSet")

lng = ListLength(List=roomsbyattr.values)
fanvariable = Ironbug_FanVariableVolume(Parameters=objparams_3, dupNum=False)
merge = Merge(Data1=oasystem, Data2=coilclndx2, Data3=coilhtnelec, Data4=fanvariable, Data5=spm_scheduled)

fanconstant = IB_FanConstantVolume(Parameters_=objparams, DuplicateNumber_=lng, dupNum=True)
coilhtnelec_2 = IB_CoilHeatingElectric(DuplicateNumber_=lng, dupNum=True)
parallelpiureheat = IB_AirTerminalSingleDuctParallelPIUReheat(HeatingCoil=coilhtnelec_2, Fan_=fanconstant, dupNum=False)

thermalzone = Ironbug_ThermalZone(
    HoneybeeZonesOrOsZones=rooms,
    AirTerminal_=parallelpiureheat,
    SizingZone=sizingzone,
    IsAirTerminalPriorToZoneEquipments=True,
    allowMultiAirloops=False,
    dupNum=False)
airloopbranches = AirLoopBranches(Branch1=thermalzone)
airloop = Ironbug_AirLoopHVAC(Supply=merge, Demand=airloopbranches, SizingSystem=sizingsystem, Parameters_=objparams_5, dupNum=False)
hvacsystem = Ironbug_HVACSystem(AirLoops=flatten(airloop))

hvacsystem_2 = ClusterOutput(hvacsystem)

# ==== cluster Sys07
hbrooms = ClusterInput()  # Honeybee Rooms to which the HVAC system should be assigned.
panel = Panel("""0.310965
0.322519
0.372745""")
panel_2 = Panel("""0.96744
0.037082
0.000434
-0.005837
-4.9e-05
-0.000274""")
panel_3 = Panel("""0.665307
-0.009339
0.000483
0.009492
0.000544
-0.000864""")
objparams = IB_ObjParams(
    MaximumValueofx="12.22",
    MaximumValueofy="29.44",
    MinimumValueofx="4.44",
    MinimumValueofy="15.56",
    DataFieldSetType="Ironbug.HVAC.Curves.IB_CurveBiquadratic_FieldSet")
curvequadratic = IB_CurveQuadratic(Coefficients=panel, dupNum=False)
curvebiquadratic = IB_CurveBiquadratic(Coefficients=panel_2, Parameters_=objparams, dupNum=False)
panel_4 = Panel("""0.33162901
-0.88567609
0.60556507
0.9484823""")
curvebiquadratic_2 = IB_CurveBiquadratic(Coefficients=panel_3, Parameters_=objparams, dupNum=False)
curvecubic = IB_CurveCubic(Coefficients=panel_4, dupNum=False)
objparams_2 = IB_ObjParams(
    RatedInletAirTemperature="12.8",
    RatedOutletAirTemperature="40",
    DataFieldSetType="Ironbug.HVAC.IB_CoilHeatingWater_FieldSet")
objparams_3 = IB_ObjParams(
    CoolingDesignAirFlowMethod="DesignDayWithLimit",
    HeatingDesignAirFlowMethod="DesignDay",
    ZoneCoolingDesignSupplyAirTemperature="12.8",
    ZoneHeatingDesignSupplyAirTemperature="40",
    DataFieldSetType="Ironbug.HVAC.IB_SizingZone_FieldSet")
objparams_4 = IB_ObjParams(
    ChillerFlowMode="ConstantFlow",
    CondenserType="WaterCooled",
    CoolingCapacityFunctionOfTemperature=curvebiquadratic,
    ElectricInputToCoolingOutputRatioFunctionOfPLR=curvequadratic,
    ElectricInputToCoolingOutputRatioFunctionOfTemperature=curvebiquadratic_2,
    LeavingChilledWaterLowerTemperatureLimit="2.22",
    MinimumPartLoadRatio="0.15",
    MinimumUnloadingRatio="0.25",
    ReferenceCOP="5.77",
    ReferenceEnteringCondenserFluidTemperature="35",
    DataFieldSetType="Ironbug.HVAC.IB_ChillerElectricEIR_FieldSet")
objparams_5 = IB_ObjParams(
    DesignApproachTemperature="2.77",
    DesignInletAirWetBulbTemperature="26.66",
    DesignRangeTemperature="5.55",
    FanPowerRatioFunctionofAirFlowRateRatioCurve=curvecubic,
    FractionofTowerCapacityinFreeConvectionRegime="0.125",
    DataFieldSetType="Ironbug.HVAC.IB_CoolingTowerVariableSpeed_FieldSet")
objparams_6 = IB_ObjParams(
    Coefficient1OfthePartLoadPerformanceCurve="0",
    Coefficient2OfthePartLoadPerformanceCurve="0.0205",
    Coefficient3OfthePartLoadPerformanceCurve="0.4101",
    Coefficient4OfthePartLoadPerformanceCurve="0.5753",
    Name="Chilled Water Loop Secondary Pump",
    RatedPumpHead="134508",
    DataFieldSetType="Ironbug.HVAC.IB_PumpVariableSpeed_FieldSet")
objparams_7 = IB_ObjParams(
    RatedInletAirTemperature="7.1",
    RatedOutletAirTemperature="12.8",
    DataFieldSetType="Ironbug.HVAC.IB_CoilHeatingWater_FieldSet")
sizingzone = IB_SizingZone(Parameters_=objparams_3, dupNum=False)
objparams_8 = IB_ObjParams(
    CoincidentSizingFactorMode="GlobalCoolingSizingFactor",
    DesignLoopExitTemperature="29.4",
    LoopDesignTemperatureDifference="5.5",
    LoopType="Condenser",
    SizingOption="Coincident",
    ZoneTimestepsinAveragingWindow="6",
    DataFieldSetType="Ironbug.HVAC.IB_SizingPlant_FieldSet")
coolingtowerv = IB_CoolingTowerVariableSpeed(Parameters_=objparams_5, dupNum=False)
objparams_9 = IB_ObjParams(RatedPumpHead="148556.6", DataFieldSetType="Ironbug.HVAC.IB_PumpConstantSpeed_FieldSet")
pumpconstant = IB_PumpConstantSpeed(Parameters_=objparams_9, dupNum=False)

# ----
# HBZones
rooms = Data(flatten(hbrooms))

# ----
# Sys07_VAV_Reheat
# Airloop
panel_5 = Panel("zone")
roomsbyattr = HBRoomsByAttribute(rooms=flatten(rooms), attribute=panel_5)  # -> values, rooms; plug-in component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
objparams_10 = IB_ObjParams(
    AllOutdoorAirinCooling=Toggle(False),
    AllOutdoorAirinHeating=Toggle(False),
    CentralHeatingDesignSupplyAirTemperature="12.8",
    SizingOption="Coincident",
    DataFieldSetType="Ironbug.HVAC.IB_SizingSystem_FieldSet")
lng = ListLength(List=roomsbyattr.values)
objparams_11 = IB_ObjParams(
    ConstantMinimumAirFlowFraction="0.2",
    DamperHeatingAction="ReverseWithLimits",
    MaximumFlowFractionDuringReheat="0.5",
    MaximumReheatAirTemperature="40",
    ZoneMinimumAirFlowInputMethod="Constant",
    DataFieldSetType="Ironbug.HVAC.IB_AirTerminalSingleDuctVAVReheat_FieldSet")
coilhtnwater = Ironbug_CoilHeatingWater(Parameters_=objparams_2, DuplicateNumber_=lng, dupNum=True)  # -> AirSide_CoilHeatingWater, WaterSide_CoilHeatingWater
objparams_12 = IB_ObjParams(EconomizerControlType="DifferentialDryBulb", DataFieldSetType="Ironbug.HVAC.IB_ControllerOutdoorAir_FieldSet")
objparams_13 = IB_ObjParams(
    EndUseSubcategory="VAV System Fans",
    FanEfficiency="0.62",
    PressureRise="996",
    DataFieldSetType="Ironbug.HVAC.IB_FanVariableVolume_FieldSet")
oacontroller = Ironbug_OAController(Parameters_=objparams_12, dupNum=False)
vavreheat = Ironbug_AirTerminalSingleDuctVAVReheat(HeatingCoil=coilhtnwater.AirSide_CoilHeatingWater, Parameters_=objparams_11, dupNum=False)
coilclnwater = Ironbug_CoilCoolingWater(dupNum=False)  # -> AirSide_CoilCoolingWater, WaterSide_CoilCoolingWater
coilhtnwater_2 = Ironbug_CoilHeatingWater(Parameters_=objparams_7, dupNum=False)  # -> AirSide_CoilHeatingWater, WaterSide_CoilHeatingWater
oasystem = Ironbug_OutdoorAirSystem(Controller_=oacontroller)
thermalzone = Ironbug_ThermalZone(
    HoneybeeZonesOrOsZones=rooms,
    AirTerminal_=vavreheat,
    SizingZone=sizingzone,
    IsAirTerminalPriorToZoneEquipments=True,
    allowMultiAirloops=False,
    dupNum=False)
fanvariable = Ironbug_FanVariableVolume(Parameters=objparams_13, dupNum=False)
spm_scheduled = Ironbug_SetpointManagerScheduled(Temperature="12.8", dupNum=False)
objparams_14 = IB_ObjParams(NightCycleControlType="CycleOnAny", DataFieldSetType="Ironbug.HVAC.IB_AirLoopHVAC_FieldSet")
branches = AirLoopBranches(Branch1=thermalzone)
sizingsystem = Ironbug_SizingSystem(Parameters_=objparams_10, dupNum=False)
merge = Merge(
    Data1=oasystem,
    Data2=coilclnwater.AirSide_CoilCoolingWater,
    Data3=coilhtnwater_2.AirSide_CoilHeatingWater,
    Data4=fanvariable,
    Data5=spm_scheduled)
airloop = Ironbug_AirLoopHVAC(Supply=merge, Demand=branches, SizingSystem=sizingsystem, Parameters_=objparams_14, dupNum=False)

# ----
# Hot water loop
panel_6 = Panel("LeavingSetpointModulated")
graft = GraftTree(Tree=coilhtnwater.WaterSide_CoilHeatingWater, IncludeEmptyLists=True, IncludeNullItems=True)
objparams_15 = IB_ObjParams(
    BoilerFlowMode=panel_6,
    MaximumPartLoadRatio="1.2",
    NominalThermalEfficiency="0.78",
    DataFieldSetType="Ironbug.HVAC.IB_BoilerHotWater_FieldSet")
boiler = Ironbug_BoilerHotWater(Parameters_=objparams_15, dupNum=False)
objparams_16 = IB_ObjParams(DesignLoopExitTemperature="82.2", DataFieldSetType="Ironbug.HVAC.IB_SizingPlant_FieldSet")
pumpvariable = Ironbug_PumpVariableSpeed(dupNum=False)
plantbranches = PlantBranches(Branch1=boiler, mapBranchToLoop=False)
plantbranches_2 = PlantBranches(B1=graft, B2=coilhtnwater_2.WaterSide_CoilHeatingWater, mapBranchToLoop=False)
spm_scheduled_2 = Ironbug_SetpointManagerScheduled(Temperature="82.2", dupNum=False)
sizingplant = IB_SizingPlant(Parameters_=objparams_16, dupNum=False)
hotwaterloop = Ironbug_HotWaterPlantLoop(Supply=[pumpvariable, plantbranches, spm_scheduled_2], Demand=plantbranches_2, SizingLoop=sizingplant, dupNum=False)

# ----
# Chilled water loop
chiller_watercooled = Ironbug_ChillerElectricEIR_WaterCooled(Parameters_=objparams_4, dupNum=False)  # -> ChillerElectricEIR, ChillerElectricEIR_CondenserLoop
objparams_17 = IB_ObjParams(
    DesignLoopExitTemperature="6.66",
    LoopDesignTemperatureDifference="5.61",
    LoopType="Cooling",
    DataFieldSetType="Ironbug.HVAC.IB_SizingPlant_FieldSet")
objparams_18 = IB_ObjParams(RatedPumpHead="44836", DataFieldSetType="Ironbug.HVAC.IB_PumpConstantSpeed_FieldSet")
objparams_19 = IB_ObjParams(CommonPipeSimulation="CommonPipe", DataFieldSetType="Ironbug.HVAC.IB_PlantLoop_FieldSet")
pumpvariable_2 = Ironbug_PumpVariableSpeed(Parameters=objparams_6, dupNum=False)
pumpconstant_2 = IB_PumpConstantSpeed(Parameters_=objparams_18, dupNum=False)
branches_2 = PlantBranches(Branch1=chiller_watercooled.ChillerElectricEIR, mapBranchToLoop=False)
spm_scheduled_3 = Ironbug_SetpointManagerScheduled(Temperature="6.7", dupNum=False)
branches_3 = PlantBranches(Branch1=coilclnwater.WaterSide_CoilCoolingWater, mapBranchToLoop=False)
sizingplant_2 = IB_SizingPlant(Parameters_=objparams_17, dupNum=False)
cwloop = Ironbug_ChilledWaterPlantLoop(
    Supply=[pumpconstant_2, branches_2, spm_scheduled_3],
    Demand=[pumpvariable_2, branches_3],
    SizingLoop=sizingplant_2,
    Parameters_=objparams_19,
    dupNum=False)

# ----
# Condenser water loop
pipeadiabatic = Ironbug_PipeAdiabatic(dupNum=False)
objparams_20 = IB_ObjParams(MaximumLoopTemperature="80", MinimumLoopTemperature="5", DataFieldSetType="Ironbug.HVAC.IB_PlantLoop_FieldSet")
spm_followoatemp = Ironbug_SetpointManagerFollowOutdoorAirTemperature(MaximumSetpointTemperature="29.4", MinimumSetpointTemperature="21.1", OffsetTemperatureDifference="2.77", dupNum=False)
plantbranches_3 = PlantBranches(Branch1=chiller_watercooled.ChillerElectricEIR_CondenserLoop, mapBranchToLoop=False)
sizingplant_3 = IB_SizingPlant(Parameters_=objparams_8, dupNum=False)
branches_4 = PlantBranches(B1=coolingtowerv, B2=pipeadiabatic, mapBranchToLoop=False)
dwloop = Ironbug_CondenserWaterPlantLoop(
    Supply=[pumpconstant, branches_4, spm_followoatemp],
    Demand=plantbranches_3,
    SizingLoop=sizingplant_3,
    Parameters_=objparams_20,
    dupNum=False)

merge_2 = Merge(Data1=hotwaterloop, Data2=cwloop, Data3=dwloop)
hvacsystem = Ironbug_HVACSystem(AirLoops=flatten(airloop), PlantLoops=flatten(merge_2))

hvacsystem_2 = ClusterOutput(hvacsystem)
